# Dynamo graph Warnings.dyn (Dynamo 2.0.1.5055)

code_block = CodeBlock { 0; }
byBestFitThroughPoints = Arc.ByBestFitThroughPoints(points=code_block)
byCenterPointRadius = Circle.ByCenterPointRadius(centerPoint=code_block, radius=code_block)
byPointsRadius = Cone.ByPointsRadius(startPoint=code_block, endPoint=code_block, startRadius=code_block)
